# Grasshopper definition patternmaking.gh (Grasshopper 1.0.7)
# plug-ins: Bifocals

number_slider = Slider(18.9, range=0..100)
rectangle = Rectangle(Plane=PlaneXY(0, 0, 0), XSize=number_slider, YSize=number_slider, Radius=0)  # -> Rectangle, Length
polygon_center = PolygonCenter(Polyline=rectangle.Rectangle)  # -> CenterV, CenterE, CenterA
scale = Scale(Geometry=rectangle.Rectangle, Center=polygon_center.CenterV, Factor=Slider(0.55, range=0..1))  # -> Geometry, Transform
point = Point(polygon_center.CenterV)
panel = Panel([polygon_center.CenterE, point, polygon_center.CenterA])
rotate_3d = Rotate3D(Geometry=scale.Geometry, Angle=degrees(Slider(-80, range=-90..90)), Center=polygon_center.CenterV, Axis=Vector(0, 0, 1))  # -> Geometry, Transform
panel_2 = Panel([rotate_3d.Transform, rotate_3d.Geometry])
# Explodes a curve into smaller segments; in this case the 4 (straight) edges of the square are separated so we can use the line segments and end points.
explode = Explode(Curve=rotate_3d.Geometry, Recursive=True)  # -> Segments, Vertices
explode_2 = Explode(Curve=rectangle.Rectangle, Recursive=True)  # -> Segments, Vertices
point_on_curve = PointOnCurve(explode.Segments, parameter=0.534)
shortest_list = ShortestList(ListA=point_on_curve, ListB=explode_2.Vertices, TrimMode=2)  # -> ListA, ListB
line = Line(StartPoint=shortest_list.ListA, EndPoint=shortest_list.ListB)
line_2 = Line(StartPoint=point, EndPoint=point_on_curve)
mirror = Mirror(Geometry=[line, line_2], Plane=PlaneYZ(0, 0, 0))  # -> Geometry, Transform
xz_plane = XZPlane(Origin=Point(0, 0, 0))
mirror_2 = Mirror(Geometry=[mirror.Geometry, line_2, line], Plane=xz_plane)  # -> Geometry, Transform
# This groups the pattern (can also use Curve)
geometry = Geometry([line, line_2, mirror_2.Geometry, mirror.Geometry])
bounding_box = BoundingBox(Content=geometry, Plane=PlaneXY(0, 0, 0), UnionBox=True)  # -> Box, Box_2
rectangular_array = RectangularArray(Geometry=geometry, Cell=bounding_box.Box, XCount=Slider(3, range=1..15), YCount=Slider(4, range=1..15))  # -> flatten(Geometry), Transform
bounding_box_2 = BoundingBox(Content=rectangular_array.Geometry, Plane=PlaneXY(0, 0, 0), UnionBox=True)  # -> Box, Box_2
surface = Surface(bounding_box_2.Box)
curve = Curve(surface)
surface_split = SurfaceSplit(Surface=surface, Curves=flatten(rectangular_array.Geometry))
number_slider_2 = Slider(2.3, range=0..10)
curve_2 = Curve(surface_split)
offset_curve_loose = OffsetCurveLoose(Curve=curve_2, Distance=expr("-x", number_slider_2))
offset_curve = OffsetCurve(Curve=curve, Distance=number_slider_2, Plane=PlaneXY(0, 0, 0), Corners=1)
boundary_surfaces = BoundarySurfaces(Edges=flatten([offset_curve_loose, offset_curve]))
surface_2 = Surface(offset_curve_loose)
unit_z = UnitZ(Factor=Slider(1.45, range=0..10))
custom_preview = CustomPreview(Geometry=surface_2, Material=ColourSwatch(SwatchColor=RGB(0, 217, 255)))
extrude = Extrude(Base=boundary_surfaces, Direction=unit_z)
