# Grasshopper definition truchet.gh (Grasshopper 1.0.7)
# plug-ins: Bifocals

plane = Plane(PlaneXY(0, 0, 0))
square = Square(Plane=plane, Size=Slider(8, range=0..100), ExtentX=Slider(16, range=0..100), ExtentY=Slider(10, range=0..100))  # -> Cells, Points
